# Grasshopper definition Selvagen_test.gh (Grasshopper 1.0.8)
# plug-ins: Selvagen

login = Login(Email="admin@selvagen.com", Password="123456", Login=Toggle(True))  # -> Session, Status
list_clients = ListClients(Refresh=Button())  # -> IDs, Names
panel = Panel(list_clients.IDs)
panel_2 = Panel(list_clients.Names)
list_item = ListItem(List=list_clients.IDs, Index=Slider(0, range=0..10), Wrap=True)
series = Series(Start=0, Step=Slider(1, range=0..10), Count=Slider(100, range=0..100))
number_slider = Slider(10, range=0..10)
unit_z = UnitZ(Factor=series)
series_2 = Series(Start=0, Step=Slider(1, range=0..10), Count=Slider(22, range=0..100))
list_projects = ListProjects(ClientID=list_item, Refresh=Button())  # -> IDs, Names
panel_3 = Panel(list_projects.IDs)
panel_4 = Panel(list_projects.Names)
unit_z_2 = UnitZ(Factor=series_2)
mesh_sphere = MeshSphere(Base=PlaneXY(0, 0, 0), Radius=number_slider, UCount=10, VCount=20)
sphere = Sphere(Base=PlaneXY(0, 0, 0), Radius=number_slider)
list_item_2 = ListItem(List=list_projects.IDs, Index=Slider(0, range=0..10), Wrap=True)
xy_plane = XYPlane(Origin=unit_z_2)
move = Move(Geometry=mesh_sphere, Motion=unit_z)  # -> flatten(Geometry), Transform
face_boundaries = FaceBoundaries(Mesh=mesh_sphere)
mesh_colours = MeshColours(
    Mesh=mesh_sphere,
    Colours=[RGB(127, 255, 0), RGB(0, 100, 0), RGB(34, 139, 34), RGB(124, 252, 0), RGB(154, 205, 50), RGB(173, 255, 47), RGB(50, 205, 50), RGB(152, 251, 152)])
mesh_plane = MeshPlane(Plane=xy_plane)  # -> flatten(Curves)
brep_plane = BrepPlane(Brep=sphere, Plane=xy_plane)  # -> flatten(Curves), Points
upload_curves = UploadCurves(
    ProjectID=list_item_2,
    Curves=brep_plane.Curves,
    Name="Contours",
    Color=ColourSwatch(SwatchColor=RGB(255, 0, 255)),
    Thickness=Slider(3, range=0..10),
    Upload=Toggle(True))  # -> CurveSetID, Status
upload_labels = UploadLabels(Upload=False)  # -> TextSetID, Status
upload_mesh = UploadMesh(ProjectID=list_item_2, Mesh=mesh_colours, Name="colored mesh", Upload=Button())  # -> MeshID, Status
upload_animation = UploadAnimation(ProjectID=list_item_2, Meshes=move.Geometry, Name="Animation", FPS="2", Loop=Toggle(True), Upload=Button())  # -> SequenceID, Status
list_assets = ListAssets(ProjectID=list_item_2, AssetType="meshes", Refresh=Button())  # -> IDs, Names, Types
list_assets_2 = ListAssets(ProjectID=list_item_2, AssetType="curves", Refresh=Button())  # -> IDs, Names, Types
panel_5 = Panel("color input")
panel_6 = Panel("espessura")
panel_7 = Panel(list_assets.Types)
panel_8 = Panel(list_assets.IDs)
panel_9 = Panel(list_assets.Names)
panel_10 = Panel(list_assets_2.IDs)
panel_11 = Panel(list_assets_2.Names)
panel_12 = Panel(list_assets_2.Types)
panel_13 = Panel(upload_curves.CurveSetID)
panel_14 = Panel(upload_curves.Status)
list_item_3 = ListItem(List=list_assets.IDs, Index=0, Wrap=True)
list_item_4 = ListItem(List=list_assets_2.IDs, Index=0, Wrap=True)
delete_asset = DeleteAsset(AssetTable="meshes", AssetID=list_item_3, Delete=Button())  # -> Success, Status
delete_asset_2 = DeleteAsset(AssetTable="curve_sets", AssetID=list_item_4, Delete=Button())  # -> Success, Status
